# Dynamo graph SAMPLE 1-1-1 겹침 제외.dyn (Dynamo 2.19.3.6394)

code_block = CodeBlock { 0..100..10; }
byCoordinates = Point.ByCoordinates(x=code_block, y=code_block, lacing=CrossProduct)
flatten = List.Flatten(list=byCoordinates)
code_block_2 = CodeBlock { 10; 30; }
byWidthLength = Rectangle.ByWidthLength(width=code_block_2.out0, length=code_block_2.out1)
origin = Point.Origin()

# group: REC 1
rec_1 = DoubleSlider(26, range=0..120 step 1)  # graph input

getItemAtIndex = List.GetItemAtIndex(list=flatten, index=rec_1)
byTwoPoints = Vector.ByTwoPoints(start=origin, end=getItemAtIndex)
translate = Geometry.Translate(geometry=byWidthLength, direction=byTwoPoints)
patch = Curve.Patch(curve=translate)
doesIntersect = Geometry.DoesIntersect(geometry=patch, other=flatten)
filterByBoolMask = List.FilterByBoolMask(list=flatten, mask=doesIntersect)
flatten_2 = List.Flatten(list=filterByBoolMask.in)
flatten_3 = List.Flatten(list=filterByBoolMask.out)
code_block_3 = CodeBlock { pints; }  # unwired: pints
code_block_4 = CodeBlock { placedsurface; }  # unwired: placedsurface
code_block_5 = CodeBlock { 40; 30; }
byWidthLength_2 = Rectangle.ByWidthLength(width=code_block_5.out0, length=code_block_5.out1)
origin_2 = Point.Origin()
byTwoPoints_2 = Vector.ByTwoPoints(start=origin_2, end=code_block_3)
translate_2 = Geometry.Translate(geometry=byWidthLength_2, direction=byTwoPoints_2)
patch_2 = Curve.Patch(curve=translate_2)
doesIntersect_2 = Geometry.DoesIntersect(geometry=code_block_4, other=patch_2)
filterByBoolMask_2 = List.FilterByBoolMask(list=code_block_3, mask=doesIntersect_2)
flatten_4 = List.Flatten(list=filterByBoolMask_2.in)

# group: 1ST
code_block_6 = CodeBlock {  }
code_block_7 = CodeBlock {  }

# group: 2ND
code_block_8 = CodeBlock {  }
code_block_9 = CodeBlock {  }

code_block_10 = CodeBlock { 40; 30; }
byWidthLength_3 = Rectangle.ByWidthLength(width=code_block_10.out0, length=code_block_10.out1)
origin_3 = Point.Origin()
flatten_5 = List.Flatten(list=filterByBoolMask_2.out)
number_slider = DoubleSlider(67, range=0..120 step 1)
getItemAtIndex_2 = List.GetItemAtIndex(list=flatten_5, index=number_slider)
byTwoPoints_3 = Vector.ByTwoPoints(start=origin_3, end=getItemAtIndex_2)
translate_3 = Geometry.Translate(geometry=byWidthLength_3, direction=byTwoPoints_3)
patch_3 = Curve.Patch(curve=translate_3)
pointAtSegmentLength = Curve.PointAtSegmentLength()  # unwired: curve
translate_4 = Geometry.Translate()  # unwired: geometry, direction
code_block_11 = CodeBlock(placedsurface=patch) { placedsurface; }
perimeterCurves = Surface.PerimeterCurves(surface=code_block_11)
byGroupedCurves = PolyCurve.ByGroupedCurves(curves=perimeterCurves)
code_block_12 = CodeBlock { -1; }
offsetMany = Curve.OffsetMany(curve=byGroupedCurves, signedDistance=code_block_12)

# group: REC 2
code_block_13 = CodeBlock { 40; 30; }
byWidthLength_4 = Rectangle.ByWidthLength(width=code_block_13.out0, length=code_block_13.out1)
origin_4 = Point.Origin()

explode = Geometry.Explode(geometry=byWidthLength_4)
firstItem = List.FirstItem(list=explode)
code_block_14 = CodeBlock { 0..1..0.5; }
pointAtParameter = Curve.PointAtParameter(curve=firstItem, param=code_block_14)
lastItem = List.LastItem(list=pointAtParameter)

# group (continued): REC 2
byTwoPoints_4 = Vector.ByTwoPoints(start=lastItem, end=origin_4)
translate_5 = Geometry.Translate(geometry=byWidthLength_4, direction=byTwoPoints_4)

ZAxis = Vector.ZAxis()
code_block_15 = CodeBlock { 0..270..90; }
rotate = Geometry.Rotate(geometry=translate_5, origin=origin_4, axis=ZAxis, degrees=code_block_15)
perimeterCurves_2 = Surface.PerimeterCurves(surface=code_block_11)
code_block_16 = CodeBlock { 0..1..0.5; }
pointAtParameter_2 = Curve.PointAtParameter(curve=perimeterCurves_2, param=code_block_16, lacing=CrossProduct)
flatten_6 = List.Flatten(list=pointAtParameter_2)
pruneDuplicates = Point.PruneDuplicates(points=flatten_6)
byTwoPoints_5 = Vector.ByTwoPoints(start=origin_4, end=pruneDuplicates)
translate_6 = Geometry.Translate(geometry=rotate, direction=byTwoPoints_5, lacing=CrossProduct)
flatten_7 = List.Flatten(list=translate_6)
byPatch = Surface.ByPatch(closedCurve=flatten_7)
doesIntersect_3 = Geometry.DoesIntersect(geometry=offsetMany, other=byPatch)
countTrue = List.CountTrue(list=doesIntersect_3)
countFalse = List.CountFalse(list=doesIntersect_3)
filterByBoolMask_3 = List.FilterByBoolMask(list=byPatch, mask=doesIntersect_3)
flatten_8 = List.Flatten(list=filterByBoolMask_3.in)
translate_7 = Geometry.Translate()  # unwired: geometry, direction

# group: REC 2
code_block_17 = CodeBlock { 40; 30; }
byWidthLength_5 = Rectangle.ByWidthLength(width=code_block_17.out0, length=code_block_17.out1)
origin_5 = Point.Origin()

explode_2 = Geometry.Explode(geometry=byWidthLength_5)
firstItem_2 = List.FirstItem(list=explode_2)
code_block_18 = CodeBlock { 0..1..0.5; }
pointAtParameter_3 = Curve.PointAtParameter(curve=firstItem_2, param=code_block_18)
lastItem_2 = List.LastItem(list=pointAtParameter_3)
pointAtSegmentLength_2 = Curve.PointAtSegmentLength()  # unwired: curve
code_block_19 = CodeBlock(placedsurface=patch) { placedsurface; }
perimeterCurves_3 = Surface.PerimeterCurves(surface=code_block_19)
byGroupedCurves_2 = PolyCurve.ByGroupedCurves(curves=perimeterCurves_3)
code_block_20 = CodeBlock { -1; }
offsetMany_2 = Curve.OffsetMany(curve=byGroupedCurves_2, signedDistance=code_block_20)
code_block_21 = CodeBlock(a=pointAtParameter_3) { a[1]; }

# group (continued): REC 2
byTwoPoints_6 = Vector.ByTwoPoints(start=code_block_21, end=origin_5)
translate_8 = Geometry.Translate(geometry=byWidthLength_5, direction=byTwoPoints_6)

ZAxis_2 = Vector.ZAxis()
code_block_22 = CodeBlock { 0..270..90; }
rotate_2 = Geometry.Rotate(geometry=translate_8, origin=origin_5, axis=ZAxis_2, degrees=code_block_22)
perimeterCurves_4 = Surface.PerimeterCurves(surface=code_block_19)
code_block_23 = CodeBlock { 0..1..0.5; }
pointAtParameter_4 = Curve.PointAtParameter(curve=perimeterCurves_4, param=code_block_23, lacing=CrossProduct)
flatten_9 = List.Flatten(list=pointAtParameter_4)
pruneDuplicates_2 = Point.PruneDuplicates(points=flatten_9)
byTwoPoints_7 = Vector.ByTwoPoints(start=origin_5, end=pruneDuplicates_2)
translate_9 = Geometry.Translate(geometry=rotate_2, direction=byTwoPoints_7, lacing=CrossProduct)
flatten_10 = List.Flatten(list=translate_9)
byPatch_2 = Surface.ByPatch(closedCurve=flatten_10)
doesIntersect_4 = Geometry.DoesIntersect(geometry=offsetMany_2, other=byPatch_2)
countTrue_2 = List.CountTrue(list=doesIntersect_4)
countFalse_2 = List.CountFalse(list=doesIntersect_4)
filterByBoolMask_4 = List.FilterByBoolMask(list=byPatch_2, mask=doesIntersect_4)
flatten_11 = List.Flatten(list=filterByBoolMask_4.in)
flatten_12 = List.Flatten(list=filterByBoolMask_3.out)
flatten_13 = List.Flatten(list=filterByBoolMask_4.out)
join = List.Join(list0=flatten_12, list1=flatten_13)

# group: REC 2
# 설명 <그룹 설명을 편집하려면 여기를 두 번 클릭하십시오.>
rec_2 = DoubleSlider(1, range=0..31 step 1)  # graph input

getItemAtIndex_3 = List.GetItemAtIndex(list=join, index=rec_2)
list_create = List.Create(item0=patch, item1=getItemAtIndex_3)
code_block_24 = CodeBlock { 20; }
thicken = Surface.Thicken(surface=list_create, thickness=code_block_24)
ea = List.Count(list=thicken)  # graph output
