# Dynamo graph SAMPLE 1-1.dyn (Dynamo 2.19.3.6394)

code_block = CodeBlock { 0..100..10; }
byCoordinates = Point.ByCoordinates(x=code_block, y=code_block, lacing=CrossProduct)
flatten = List.Flatten(list=byCoordinates)
code_block_2 = CodeBlock { 10; 30; }
byWidthLength = Rectangle.ByWidthLength(width=code_block_2.out0, length=code_block_2.out1)
origin = Point.Origin()
number_slider = DoubleSlider(93, range=0..120 step 1)
getItemAtIndex = List.GetItemAtIndex(list=flatten, index=number_slider)
byTwoPoints = Vector.ByTwoPoints(start=origin, end=getItemAtIndex)
translate = Geometry.Translate(geometry=byWidthLength, direction=byTwoPoints)
patch = Curve.Patch(curve=translate)
doesIntersect = Geometry.DoesIntersect(geometry=patch, other=flatten)
filterByBoolMask = List.FilterByBoolMask(list=flatten, mask=doesIntersect)
flatten_2 = List.Flatten(list=filterByBoolMask.in)
flatten_3 = List.Flatten(list=filterByBoolMask.out)
code_block_3 = CodeBlock { pints; }  # unwired: pints
code_block_4 = CodeBlock { placedsurface; }  # unwired: placedsurface
code_block_5 = CodeBlock { 40; 30; }
byWidthLength_2 = Rectangle.ByWidthLength(width=code_block_5.out0, length=code_block_5.out1)
origin_2 = Point.Origin()
byTwoPoints_2 = Vector.ByTwoPoints(start=origin_2, end=code_block_3)
translate_2 = Geometry.Translate(geometry=byWidthLength_2, direction=byTwoPoints_2)
patch_2 = Curve.Patch(curve=translate_2)
doesIntersect_2 = Geometry.DoesIntersect(geometry=code_block_4, other=patch_2)
filterByBoolMask_2 = List.FilterByBoolMask(list=code_block_3, mask=doesIntersect_2)
flatten_4 = List.Flatten(list=filterByBoolMask_2.in)

# group: 1ST
code_block_6 = CodeBlock {  }
code_block_7 = CodeBlock {  }

# group: 2ND
code_block_8 = CodeBlock {  }
code_block_9 = CodeBlock {  }

code_block_10 = CodeBlock { 40; 30; }
byWidthLength_3 = Rectangle.ByWidthLength(width=code_block_10.out0, length=code_block_10.out1)
origin_3 = Point.Origin()
flatten_5 = List.Flatten(list=filterByBoolMask_2.out)
number_slider_2 = DoubleSlider(4, range=0..120 step 1)
getItemAtIndex_2 = List.GetItemAtIndex(list=flatten_5, index=number_slider_2)
byTwoPoints_3 = Vector.ByTwoPoints(start=origin_3, end=getItemAtIndex_2)
translate_3 = Geometry.Translate(geometry=byWidthLength_3, direction=byTwoPoints_3)
patch_3 = Curve.Patch(curve=translate_3)
pointAtSegmentLength = Curve.PointAtSegmentLength()  # unwired: curve
code_block_11 = CodeBlock(placedsurface=patch) { placedsurface; }
perimeterCurves = Surface.PerimeterCurves(surface=code_block_11)
code_block_12 = CodeBlock { 0..1..0.5; }
pointAtParameter = Curve.PointAtParameter(curve=perimeterCurves, param=code_block_12, lacing=CrossProduct)
flatten_6 = List.Flatten(list=pointAtParameter)
pruneDuplicates = Point.PruneDuplicates(points=flatten_6)

# group: REC 2
code_block_13 = CodeBlock { 40; 30; }
byWidthLength_4 = Rectangle.ByWidthLength(width=code_block_13.out0, length=code_block_13.out1)
origin_4 = Point.Origin()

explode = Geometry.Explode(geometry=byWidthLength_4)
firstItem = List.FirstItem(list=explode)
code_block_14 = CodeBlock { 0..1..0.5; }
pointAtParameter_2 = Curve.PointAtParameter(curve=firstItem, param=code_block_14)
lastItem = List.LastItem(list=pointAtParameter_2)

# group (continued): REC 2
byTwoPoints_4 = Vector.ByTwoPoints(start=lastItem, end=origin_4)
translate_4 = Geometry.Translate(geometry=byWidthLength_4, direction=byTwoPoints_4)

ZAxis = Vector.ZAxis()
code_block_15 = CodeBlock { 0..270..90; }
rotate = Geometry.Rotate(geometry=translate_4, origin=origin_4, axis=ZAxis, degrees=code_block_15)
translate_5 = Geometry.Translate()  # unwired: geometry, direction
