# Dynamo graph SAMPLE 1.dyn (Dynamo 2.19.3.6394)

code_block = CodeBlock { 0..100..10; }
byCoordinates = Point.ByCoordinates(x=code_block, y=code_block, lacing=CrossProduct)
flatten = List.Flatten(list=byCoordinates)
code_block_2 = CodeBlock { 10; 30; }
byWidthLength = Rectangle.ByWidthLength(width=code_block_2.out0, length=code_block_2.out1)
origin = Point.Origin()
number_slider = DoubleSlider(120, range=0..120 step 1)
getItemAtIndex = List.GetItemAtIndex(list=flatten, index=number_slider)
byTwoPoints = Vector.ByTwoPoints(start=origin, end=getItemAtIndex)
translate = Geometry.Translate(geometry=byWidthLength, direction=byTwoPoints)
patch = Curve.Patch(curve=translate)
doesIntersect = Geometry.DoesIntersect(geometry=patch, other=flatten)
filterByBoolMask = List.FilterByBoolMask(list=flatten, mask=doesIntersect)
flatten_2 = List.Flatten(list=filterByBoolMask.in)
flatten_3 = List.Flatten(list=filterByBoolMask.out)
code_block_3 = CodeBlock { 40; 30; }
byWidthLength_2 = Rectangle.ByWidthLength(width=code_block_3.out0, length=code_block_3.out1)
origin_2 = Point.Origin()
byTwoPoints_2 = Vector.ByTwoPoints(start=origin_2, end=flatten_3)
translate_2 = Geometry.Translate(geometry=byWidthLength_2, direction=byTwoPoints_2)
patch_2 = Curve.Patch(curve=translate_2)
doesIntersect_2 = Geometry.DoesIntersect(geometry=patch, other=patch_2)
filterByBoolMask_2 = List.FilterByBoolMask(list=flatten_3, mask=doesIntersect_2)
flatten_4 = List.Flatten(list=filterByBoolMask_2.in)

# group: 1ST
code_block_4 = CodeBlock {  }
code_block_5 = CodeBlock {  }

# group: 2ND
code_block_6 = CodeBlock {  }
code_block_7 = CodeBlock {  }

code_block_8 = CodeBlock { 40; 30; }
byWidthLength_3 = Rectangle.ByWidthLength(width=code_block_8.out0, length=code_block_8.out1)
origin_3 = Point.Origin()
flatten_5 = List.Flatten(list=filterByBoolMask_2.out)
number_slider_2 = DoubleSlider(4, range=0..120 step 1)
getItemAtIndex_2 = List.GetItemAtIndex(list=flatten_5, index=number_slider_2)
byTwoPoints_3 = Vector.ByTwoPoints(start=origin_3, end=getItemAtIndex_2)
translate_3 = Geometry.Translate(geometry=byWidthLength_3, direction=byTwoPoints_3)
patch_3 = Curve.Patch(curve=translate_3)
