# Dynamo graph 2500726 정수장 python 최적화 v1.dyn (Dynamo 2.19.3.6394)
# packages: GenerativeDesign 6.1.1.0, Dynamo Text 2.0.1

# group: 박스
# 설명 <그룹 설명을 편집하려면 여기를 두 번 클릭하십시오.>
select_model_element = DSModelElementSelection()  # 1 picked in the model
geometry = Element.Geometry(element=select_model_element)

code_block = CodeBlock { 0.5; }

# group: 대지 경계
# 설명 <그룹 설명을 편집하려면 여기를 두 번 클릭하십시오.>
select_model_element_2 = DSModelElementSelection()  # 1 picked in the model
geometry_2 = Element.Geometry(element=select_model_element_2)

# group: 영역(바닥)
# 설명 <그룹 설명을 편집하려면 여기를 두 번 클릭하십시오.>
바닥_선택 = DSModelElementSelection()  # 1 picked in the model
points = Floor.Points(floor=바닥_선택)
geometry_3 = Element.Geometry(element=바닥_선택)

# group: rec0 배치
# 설명 <그룹 설명을 편집하려면 여기를 두 번 클릭하십시오.>
code_block_2 = CodeBlock {  }
code_block_3 = CodeBlock {  }

# group: rec1 배치
# 설명 <그룹 설명을 편집하려면 여기를 두 번 클릭하십시오.>
code_block_4 = CodeBlock {  }
code_block_5 = CodeBlock {  }

# group: rec2 배치
# 설명 <그룹 설명을 편집하려면 여기를 두 번 클릭하십시오.>
code_block_6 = CodeBlock {  }
code_block_7 = CodeBlock {  }

# group: rec3 배치
# 설명 <그룹 설명을 편집하려면 여기를 두 번 클릭하십시오.>
code_block_8 = CodeBlock {  }
code_block_9 = CodeBlock {  }

# group: rec4 배치
# 설명 <그룹 설명을 편집하려면 여기를 두 번 클릭하십시오.>
code_block_10 = CodeBlock {  }
code_block_11 = CodeBlock {  }

# group: rec6 배치
# 설명 <그룹 설명을 편집하려면 여기를 두 번 클릭하십시오.>
code_block_12 = CodeBlock {  }
code_block_13 = CodeBlock {  }

# group: rec7 배치
# 설명 <그룹 설명을 편집하려면 여기를 두 번 클릭하십시오.>
code_block_14 = CodeBlock {  }
code_block_15 = CodeBlock {  }

# group: rec8 배치
# 설명 <그룹 설명을 편집하려면 여기를 두 번 클릭하십시오.>
code_block_16 = CodeBlock {  }
code_block_17 = CodeBlock {  }

# group: rec5 배치
# 설명 <그룹 설명을 편집하려면 여기를 두 번 클릭하십시오.>
code_block_18 = CodeBlock {  }
code_block_19 = CodeBlock {  }

# group: rec10 배치
# 설명 <그룹 설명을 편집하려면 여기를 두 번 클릭하십시오.>
code_block_20 = CodeBlock {  }
code_block_21 = CodeBlock {  }

# group: rec9 배치
# 설명 <그룹 설명을 편집하려면 여기를 두 번 클릭하십시오.>
code_block_22 = CodeBlock {  }
code_block_23 = CodeBlock {  }

# group: 출입
# 설명 <그룹 설명을 편집하려면 여기를 두 번 클릭하십시오.>
select_model_element_3 = DSModelElementSelection()  # 1 picked in the model
geometry_4 = Element.Geometry(element=select_model_element_3)

# group: Data Remember
# 설명 <그룹 설명을 편집하려면 여기를 두 번 클릭하십시오.>
remember = Data.Remember(geometry)
remember_2 = Data.Remember(geometry_2)
remember_3 = Data.Remember(points)
remember_4 = Data.Remember(geometry_4)

# group: Scale 1/1000
# 설명 <그룹 설명을 편집하려면 여기를 두 번 클릭하십시오.>
code_block_24 = CodeBlock { 1/1000; }
scale = Geometry.Scale(geometry=remember, amount=code_block_24)
scale_2 = Geometry.Scale(geometry=remember_2, amount=code_block_24)
scale_3 = Geometry.Scale(geometry=remember_3, amount=code_block_24)
scale_4 = Geometry.Scale(geometry=remember_4, amount=code_block_24)

byPatch = Surface.ByPatch(closedCurve=scale)
pointAtParameter = Surface.PointAtParameter(surface=byPatch, u=code_block, v=code_block, lacing=CrossProduct)

# group: 대지 내부 배치 가능 포인트 - 추후 지형, 이격 관련 추가해야함
# 설명 <그룹 설명을 편집하려면 여기를 두 번 클릭하십시오.>
byPatch_2 = Surface.ByPatch(closedCurve=scale_2)
code_block_25 = CodeBlock { 0..1..0.02; }
pointAtParameter_2 = Surface.PointAtParameter(surface=byPatch_2, u=code_block_25, v=code_block_25, lacing=CrossProduct)
flatten = List.Flatten(list=pointAtParameter_2)
thicken = Surface.Thicken(surface=byPatch_2)
doesIntersect = Geometry.DoesIntersect(geometry=thicken, other=flatten, lacing=Longest)
filterByBoolMask = List.FilterByBoolMask(list=flatten, mask=doesIntersect)
flatten_2 = List.Flatten(list=filterByBoolMask.in)

byPoints = Polygon.ByPoints(points=scale_3)
byPatch_3 = Surface.ByPatch(closedCurve=byPoints)

# group: 점 Shuffle (Input)
# 설명 <그룹 설명을 편집하려면 여기를 두 번 클릭하십시오.>
intersect = Geometry.Intersect(geometry=flatten_2, other=byPatch_3)
flatten_3 = List.Flatten(list=intersect)
n0 = IntegerSlider(59, range=0..100 step 1)  # "0"; graph input
shuffle = List.Shuffle(list=flatten_3, seed=n0)

# group: 제외영역 Set
# 설명 <그룹 설명을 편집하려면 여기를 두 번 클릭하십시오.>
code_block_26 = CodeBlock(대지경계=scale_2) { 대지경계; }
code_block_27 = CodeBlock { -10; }
offsetMany = Curve.OffsetMany(curve=code_block_26, signedDistance=code_block_27)
join = List.Join(list0=code_block_26, list1=offsetMany)
byLoft = Surface.ByLoft(crossSections=join)
thicken_2 = Surface.Thicken(surface=byLoft)

# group: 박스 배치 (대지경계와 안겹치는) - 추후 도로 및 이동 관련 추가해야함
# 설명 <그룹 설명을 편집하려면 여기를 두 번 클릭하십시오.>
박스INDEX = CodeBlock { 0; }
code_block_28 = CodeBlock(a=byPatch, b=박스INDEX) { a[b]; }
code_block_29 = CodeBlock(a=pointAtParameter, b=박스INDEX) { a[b]; }
byTwoPoints = Vector.ByTwoPoints(start=code_block_29, end=shuffle)
translate = Geometry.Translate(geometry=code_block_28, direction=byTwoPoints)
code_block_30 = CodeBlock(제외영역=thicken_2) { 제외영역; }
doesIntersect_2 = Geometry.DoesIntersect(geometry=code_block_30, other=translate, lacing=Longest)
filterByBoolMask_2 = List.FilterByBoolMask(list=translate, mask=doesIntersect_2)
flatten_4 = List.Flatten(list=filterByBoolMask_2.in)
flatten_5 = List.Flatten(list=filterByBoolMask_2.out)
firstItem = List.FirstItem(list=flatten_5)

# group: 점 정리
# 설명 <그룹 설명을 편집하려면 여기를 두 번 클릭하십시오.>
intersect_2 = Geometry.Intersect(geometry=flatten_2, other=firstItem)
flatten_6 = List.Flatten(list=intersect_2)
setDifference = List.SetDifference(list1=flatten_2, list2=flatten_6)

# group: 점 Shuffle (Input)
# 설명 <그룹 설명을 편집하려면 여기를 두 번 클릭하십시오.>
intersect_3 = Geometry.Intersect(geometry=setDifference, other=byPatch_3)
flatten_7 = List.Flatten(list=intersect_3)
n1 = IntegerSlider(59, range=0..100 step 1)  # "1"; graph input
shuffle_2 = List.Shuffle(list=flatten_7, seed=n1)

# group: 제외영역 Surface > PolySurface
# 설명 <그룹 설명을 편집하려면 여기를 두 번 클릭하십시오.>
code_block_31 = CodeBlock(제외영역=byLoft) { 제외영역; }
join_2 = List.Join(list0=code_block_31, list1=firstItem)
byJoinedSurfaces = PolySurface.ByJoinedSurfaces(surfaces=join_2)

# group: 박스 배치 (대지경계와 안겹치는) - 추후 도로 및 이동 관련 추가해야함
# 설명 <그룹 설명을 편집하려면 여기를 두 번 클릭하십시오.>
박스INDEX_2 = CodeBlock { 1; }
code_block_32 = CodeBlock(a=byPatch, b=박스INDEX_2) { a[b]; }
code_block_33 = CodeBlock(a=pointAtParameter, b=박스INDEX_2) { a[b]; }
byTwoPoints_2 = Vector.ByTwoPoints(start=code_block_33, end=shuffle_2)
translate_2 = Geometry.Translate(geometry=code_block_32, direction=byTwoPoints_2)
code_block_34 = CodeBlock(제외영역=byJoinedSurfaces) { 제외영역; }
doesIntersect_3 = Geometry.DoesIntersect(geometry=code_block_34, other=translate_2, lacing=Longest)
filterByBoolMask_3 = List.FilterByBoolMask(list=translate_2, mask=doesIntersect_3)
flatten_8 = List.Flatten(list=filterByBoolMask_3.in)
flatten_9 = List.Flatten(list=filterByBoolMask_3.out)
firstItem_2 = List.FirstItem(list=flatten_9)

# group: 점 정리
# 설명 <그룹 설명을 편집하려면 여기를 두 번 클릭하십시오.>
intersect_4 = Geometry.Intersect(geometry=shuffle_2, other=firstItem_2)
flatten_10 = List.Flatten(list=intersect_4)
setDifference_2 = List.SetDifference(list1=setDifference, list2=flatten_10)

# group: 점 Shuffle (Input)
# 설명 <그룹 설명을 편집하려면 여기를 두 번 클릭하십시오.>
n2 = IntegerSlider(45, range=0..100 step 1)  # "2"; graph input
shuffle_3 = List.Shuffle(list=setDifference_2, seed=n2)

# group: 제외영역 Surface > PolySurface
# 설명 <그룹 설명을 편집하려면 여기를 두 번 클릭하십시오.>
code_block_35 = CodeBlock(제외영역=byJoinedSurfaces) { 제외영역; }
join_3 = List.Join(list0=code_block_35, list1=firstItem_2)
byJoinedSurfaces_2 = PolySurface.ByJoinedSurfaces(surfaces=join_3)

# group: 박스 배치 (대지경계와 안겹치는) - 추후 도로 및 이동 관련 추가해야함
# 설명 <그룹 설명을 편집하려면 여기를 두 번 클릭하십시오.>
박스INDEX_3 = CodeBlock { 2; }
code_block_36 = CodeBlock(a=byPatch, b=박스INDEX_3) { a[b]; }
code_block_37 = CodeBlock(a=pointAtParameter, b=박스INDEX_3) { a[b]; }
byTwoPoints_3 = Vector.ByTwoPoints(start=code_block_37, end=shuffle_3)
translate_3 = Geometry.Translate(geometry=code_block_36, direction=byTwoPoints_3)
code_block_38 = CodeBlock(제외영역=byJoinedSurfaces_2) { 제외영역; }
doesIntersect_4 = Geometry.DoesIntersect(geometry=code_block_38, other=translate_3, lacing=Longest)
filterByBoolMask_4 = List.FilterByBoolMask(list=translate_3, mask=doesIntersect_4)
flatten_11 = List.Flatten(list=filterByBoolMask_4.in)
flatten_12 = List.Flatten(list=filterByBoolMask_4.out)
firstItem_3 = List.FirstItem(list=flatten_12)

# group: 점 정리
# 설명 <그룹 설명을 편집하려면 여기를 두 번 클릭하십시오.>
intersect_5 = Geometry.Intersect(geometry=shuffle_3, other=firstItem_3)
flatten_13 = List.Flatten(list=intersect_5)
setDifference_3 = List.SetDifference(list1=setDifference_2, list2=flatten_13)

# group: 점 Shuffle (Input)
# 설명 <그룹 설명을 편집하려면 여기를 두 번 클릭하십시오.>
n3 = IntegerSlider(0, range=0..100 step 1)  # "3"; graph input
shuffle_4 = List.Shuffle(list=setDifference_3, seed=n3)

# group: 제외영역 Surface > PolySurface
# 설명 <그룹 설명을 편집하려면 여기를 두 번 클릭하십시오.>
code_block_39 = CodeBlock(제외영역=byJoinedSurfaces_2) { 제외영역; }
join_4 = List.Join(list0=code_block_39, list1=firstItem_3)
byJoinedSurfaces_3 = PolySurface.ByJoinedSurfaces(surfaces=join_4)

# group: 박스 배치 (대지경계와 안겹치는) - 추후 도로 및 이동 관련 추가해야함
# 설명 <그룹 설명을 편집하려면 여기를 두 번 클릭하십시오.>
박스INDEX_4 = CodeBlock { 3; }
code_block_40 = CodeBlock(a=byPatch, b=박스INDEX_4) { a[b]; }
code_block_41 = CodeBlock(a=pointAtParameter, b=박스INDEX_4) { a[b]; }
byTwoPoints_4 = Vector.ByTwoPoints(start=code_block_41, end=shuffle_4)
translate_4 = Geometry.Translate(geometry=code_block_40, direction=byTwoPoints_4)
code_block_42 = CodeBlock(제외영역=byJoinedSurfaces_3) { 제외영역; }
doesIntersect_5 = Geometry.DoesIntersect(geometry=code_block_42, other=translate_4, lacing=Longest)
filterByBoolMask_5 = List.FilterByBoolMask(list=translate_4, mask=doesIntersect_5)
flatten_14 = List.Flatten(list=filterByBoolMask_5.in)
flatten_15 = List.Flatten(list=filterByBoolMask_5.out)
firstItem_4 = List.FirstItem(list=flatten_15)

# group: 점 정리
# 설명 <그룹 설명을 편집하려면 여기를 두 번 클릭하십시오.>
intersect_6 = Geometry.Intersect(geometry=shuffle_4, other=firstItem_4)
flatten_16 = List.Flatten(list=intersect_6)
setDifference_4 = List.SetDifference(list1=setDifference_3, list2=flatten_16)

# group: 점 Shuffle (Input)
# 설명 <그룹 설명을 편집하려면 여기를 두 번 클릭하십시오.>
n4 = IntegerSlider(0, range=0..100 step 1)  # "4"; graph input
shuffle_5 = List.Shuffle(list=setDifference_4, seed=n4)

# group: 제외영역 Surface > PolySurface
# 설명 <그룹 설명을 편집하려면 여기를 두 번 클릭하십시오.>
code_block_43 = CodeBlock(제외영역=byJoinedSurfaces_3) { 제외영역; }
join_5 = List.Join(list0=code_block_43, list1=firstItem_4)
byJoinedSurfaces_4 = PolySurface.ByJoinedSurfaces(surfaces=join_5)

# group: 박스 배치 (대지경계와 안겹치는) - 추후 도로 및 이동 관련 추가해야함
# 설명 <그룹 설명을 편집하려면 여기를 두 번 클릭하십시오.>
박스INDEX_5 = CodeBlock { 4; }
code_block_44 = CodeBlock(a=byPatch, b=박스INDEX_5) { a[b]; }
code_block_45 = CodeBlock(a=pointAtParameter, b=박스INDEX_5) { a[b]; }
byTwoPoints_5 = Vector.ByTwoPoints(start=code_block_45, end=shuffle_5)
translate_5 = Geometry.Translate(geometry=code_block_44, direction=byTwoPoints_5)
code_block_46 = CodeBlock(제외영역=byJoinedSurfaces_4) { 제외영역; }
doesIntersect_6 = Geometry.DoesIntersect(geometry=code_block_46, other=translate_5, lacing=Longest)
filterByBoolMask_6 = List.FilterByBoolMask(list=translate_5, mask=doesIntersect_6)
flatten_17 = List.Flatten(list=filterByBoolMask_6.in)
flatten_18 = List.Flatten(list=filterByBoolMask_6.out)
firstItem_5 = List.FirstItem(list=flatten_18)

# group: 점 정리
# 설명 <그룹 설명을 편집하려면 여기를 두 번 클릭하십시오.>
intersect_7 = Geometry.Intersect(geometry=shuffle_5, other=firstItem_5)
flatten_19 = List.Flatten(list=intersect_7)
setDifference_5 = List.SetDifference(list1=setDifference_4, list2=flatten_19)

# group: 점 Shuffle (Input)
# 설명 <그룹 설명을 편집하려면 여기를 두 번 클릭하십시오.>
n5 = IntegerSlider(0, range=0..100 step 1)  # "5"; graph input
shuffle_6 = List.Shuffle(list=setDifference_5, seed=n5)

# group: 제외영역 Surface > PolySurface
# 설명 <그룹 설명을 편집하려면 여기를 두 번 클릭하십시오.>
code_block_47 = CodeBlock(제외영역=byJoinedSurfaces_4) { 제외영역; }
join_6 = List.Join(list0=code_block_47, list1=firstItem_5)
byJoinedSurfaces_5 = PolySurface.ByJoinedSurfaces(surfaces=join_6)

# group: 박스 배치 (대지경계와 안겹치는) - 추후 도로 및 이동 관련 추가해야함
# 설명 <그룹 설명을 편집하려면 여기를 두 번 클릭하십시오.>
박스INDEX_6 = CodeBlock { 5; }
code_block_48 = CodeBlock(a=byPatch, b=박스INDEX_6) { a[b]; }
code_block_49 = CodeBlock(a=pointAtParameter, b=박스INDEX_6) { a[b]; }
byTwoPoints_6 = Vector.ByTwoPoints(start=code_block_49, end=shuffle_6)
translate_6 = Geometry.Translate(geometry=code_block_48, direction=byTwoPoints_6)
code_block_50 = CodeBlock(제외영역=byJoinedSurfaces_5) { 제외영역; }
doesIntersect_7 = Geometry.DoesIntersect(geometry=code_block_50, other=translate_6, lacing=Longest)
filterByBoolMask_7 = List.FilterByBoolMask(list=translate_6, mask=doesIntersect_7)
flatten_20 = List.Flatten(list=filterByBoolMask_7.out)
firstItem_6 = List.FirstItem(list=flatten_20)
flatten_21 = List.Flatten(list=filterByBoolMask_7.in)

# group: 점 정리
# 설명 <그룹 설명을 편집하려면 여기를 두 번 클릭하십시오.>
intersect_8 = Geometry.Intersect(geometry=shuffle_6, other=firstItem_6)
flatten_22 = List.Flatten(list=intersect_8)
setDifference_6 = List.SetDifference(list1=setDifference_5, list2=flatten_22)

# group: 점 Shuffle (Input)
# 설명 <그룹 설명을 편집하려면 여기를 두 번 클릭하십시오.>
n6 = IntegerSlider(0, range=0..100 step 1)  # "6"; graph input
shuffle_7 = List.Shuffle(list=setDifference_6, seed=n6)

# group: 제외영역 Surface > PolySurface
# 설명 <그룹 설명을 편집하려면 여기를 두 번 클릭하십시오.>
code_block_51 = CodeBlock(제외영역=byJoinedSurfaces_5) { 제외영역; }
join_7 = List.Join(list0=code_block_51, list1=firstItem_6)
byJoinedSurfaces_6 = PolySurface.ByJoinedSurfaces(surfaces=join_7)

# group: 박스 배치 (대지경계와 안겹치는) - 추후 도로 및 이동 관련 추가해야함
# 설명 <그룹 설명을 편집하려면 여기를 두 번 클릭하십시오.>
박스INDEX_7 = CodeBlock { 6; }
code_block_52 = CodeBlock(a=byPatch, b=박스INDEX_7) { a[b]; }
code_block_53 = CodeBlock(a=pointAtParameter, b=박스INDEX_7) { a[b]; }
byTwoPoints_7 = Vector.ByTwoPoints(start=code_block_53, end=shuffle_7)
translate_7 = Geometry.Translate(geometry=code_block_52, direction=byTwoPoints_7)
code_block_54 = CodeBlock(제외영역=byJoinedSurfaces_6) { 제외영역; }
doesIntersect_8 = Geometry.DoesIntersect(geometry=code_block_54, other=translate_7, lacing=Longest)
filterByBoolMask_8 = List.FilterByBoolMask(list=translate_7, mask=doesIntersect_8)
flatten_23 = List.Flatten(list=filterByBoolMask_8.out)
firstItem_7 = List.FirstItem(list=flatten_23)
flatten_24 = List.Flatten(list=filterByBoolMask_8.in)

# group: 점 정리
# 설명 <그룹 설명을 편집하려면 여기를 두 번 클릭하십시오.>
intersect_9 = Geometry.Intersect(geometry=shuffle_7, other=firstItem_7)
flatten_25 = List.Flatten(list=intersect_9)
setDifference_7 = List.SetDifference(list1=setDifference_6, list2=flatten_25)

# group: 점 Shuffle (Input)
# 설명 <그룹 설명을 편집하려면 여기를 두 번 클릭하십시오.>
n7 = IntegerSlider(0, range=0..100 step 1)  # "7"; graph input
shuffle_8 = List.Shuffle(list=setDifference_7, seed=n7)

# group: 제외영역 Surface > PolySurface
# 설명 <그룹 설명을 편집하려면 여기를 두 번 클릭하십시오.>
code_block_55 = CodeBlock(제외영역=byJoinedSurfaces_6) { 제외영역; }
join_8 = List.Join(list0=code_block_55, list1=firstItem_7)
byJoinedSurfaces_7 = PolySurface.ByJoinedSurfaces(surfaces=join_8)

# group: 박스 배치 (대지경계와 안겹치는) - 추후 도로 및 이동 관련 추가해야함
# 설명 <그룹 설명을 편집하려면 여기를 두 번 클릭하십시오.>
박스INDEX_8 = CodeBlock { 7; }
code_block_56 = CodeBlock(a=byPatch, b=박스INDEX_8) { a[b]; }
code_block_57 = CodeBlock(a=pointAtParameter, b=박스INDEX_8) { a[b]; }
byTwoPoints_8 = Vector.ByTwoPoints(start=code_block_57, end=shuffle_8)
translate_8 = Geometry.Translate(geometry=code_block_56, direction=byTwoPoints_8)
code_block_58 = CodeBlock(제외영역=byJoinedSurfaces_7) { 제외영역; }
doesIntersect_9 = Geometry.DoesIntersect(geometry=code_block_58, other=translate_8, lacing=Longest)
filterByBoolMask_9 = List.FilterByBoolMask(list=translate_8, mask=doesIntersect_9)
flatten_26 = List.Flatten(list=filterByBoolMask_9.out)
firstItem_8 = List.FirstItem(list=flatten_26)
flatten_27 = List.Flatten(list=filterByBoolMask_9.in)

# group: 점 정리
# 설명 <그룹 설명을 편집하려면 여기를 두 번 클릭하십시오.>
intersect_10 = Geometry.Intersect(geometry=shuffle_8, other=firstItem_8)
flatten_28 = List.Flatten(list=intersect_10)
setDifference_8 = List.SetDifference(list1=setDifference_7, list2=flatten_28)

# group: 점 Shuffle (Input)
# 설명 <그룹 설명을 편집하려면 여기를 두 번 클릭하십시오.>
n8 = IntegerSlider(0, range=0..100 step 1)  # "8"; graph input
shuffle_9 = List.Shuffle(list=setDifference_8, seed=n8)

# group: 제외영역 Surface > PolySurface
# 설명 <그룹 설명을 편집하려면 여기를 두 번 클릭하십시오.>
code_block_59 = CodeBlock(제외영역=byJoinedSurfaces_7) { 제외영역; }
join_9 = List.Join(list0=code_block_59, list1=firstItem_8)
byJoinedSurfaces_8 = PolySurface.ByJoinedSurfaces(surfaces=join_9)

# group: 박스 배치 (대지경계와 안겹치는) - 추후 도로 및 이동 관련 추가해야함
# 설명 <그룹 설명을 편집하려면 여기를 두 번 클릭하십시오.>
박스INDEX_9 = CodeBlock { 8; }
code_block_60 = CodeBlock(a=byPatch, b=박스INDEX_9) { a[b]; }
code_block_61 = CodeBlock(a=pointAtParameter, b=박스INDEX_9) { a[b]; }
byTwoPoints_9 = Vector.ByTwoPoints(start=code_block_61, end=shuffle_9)
translate_9 = Geometry.Translate(geometry=code_block_60, direction=byTwoPoints_9)
code_block_62 = CodeBlock(제외영역=byJoinedSurfaces_8) { 제외영역; }
doesIntersect_10 = Geometry.DoesIntersect(geometry=code_block_62, other=translate_9, lacing=Longest)
filterByBoolMask_10 = List.FilterByBoolMask(list=translate_9, mask=doesIntersect_10)
flatten_29 = List.Flatten(list=filterByBoolMask_10.in)
flatten_30 = List.Flatten(list=filterByBoolMask_10.out)
firstItem_9 = List.FirstItem(list=flatten_30)

# group: 점 정리
# 설명 <그룹 설명을 편집하려면 여기를 두 번 클릭하십시오.>
intersect_11 = Geometry.Intersect(geometry=shuffle_9, other=firstItem_9)
flatten_31 = List.Flatten(list=intersect_11)
setDifference_9 = List.SetDifference(list1=setDifference_8, list2=flatten_31)

# group: 점 Shuffle (Input)
# 설명 <그룹 설명을 편집하려면 여기를 두 번 클릭하십시오.>
n9 = IntegerSlider(0, range=0..100 step 1)  # "9"; graph input
shuffle_10 = List.Shuffle(list=setDifference_9, seed=n9)

# group: 제외영역 Surface > PolySurface
# 설명 <그룹 설명을 편집하려면 여기를 두 번 클릭하십시오.>
code_block_63 = CodeBlock(제외영역=byJoinedSurfaces_8) { 제외영역; }
join_10 = List.Join(list0=code_block_63, list1=firstItem_9)
byJoinedSurfaces_9 = PolySurface.ByJoinedSurfaces(surfaces=join_10)

# group: 박스 배치 (대지경계와 안겹치는) - 추후 도로 및 이동 관련 추가해야함
# 설명 <그룹 설명을 편집하려면 여기를 두 번 클릭하십시오.>
박스INDEX_10 = CodeBlock { 9; }
code_block_64 = CodeBlock(a=byPatch, b=박스INDEX_10) { a[b]; }
code_block_65 = CodeBlock(a=pointAtParameter, b=박스INDEX_10) { a[b]; }
byTwoPoints_10 = Vector.ByTwoPoints(start=code_block_65, end=shuffle_10)
translate_10 = Geometry.Translate(geometry=code_block_64, direction=byTwoPoints_10)
code_block_66 = CodeBlock(제외영역=byJoinedSurfaces_9) { 제외영역; }
doesIntersect_11 = Geometry.DoesIntersect(geometry=code_block_66, other=translate_10, lacing=Longest)
filterByBoolMask_11 = List.FilterByBoolMask(list=translate_10, mask=doesIntersect_11)
flatten_32 = List.Flatten(list=filterByBoolMask_11.out)
firstItem_10 = List.FirstItem(list=flatten_32)
flatten_33 = List.Flatten(list=filterByBoolMask_11.in)

# group: 점 정리
# 설명 <그룹 설명을 편집하려면 여기를 두 번 클릭하십시오.>
intersect_12 = Geometry.Intersect(geometry=shuffle_10, other=firstItem_10)
flatten_34 = List.Flatten(list=intersect_12)
setDifference_10 = List.SetDifference(list1=setDifference_9, list2=flatten_34)

# group: 점 Shuffle (Input)
# 설명 <그룹 설명을 편집하려면 여기를 두 번 클릭하십시오.>
n10 = IntegerSlider(0, range=0..100 step 1)  # "10"; graph input
shuffle_11 = List.Shuffle(list=setDifference_10, seed=n10)

# group: 제외영역 Surface > PolySurface
# 설명 <그룹 설명을 편집하려면 여기를 두 번 클릭하십시오.>
code_block_67 = CodeBlock(제외영역=byJoinedSurfaces_9) { 제외영역; }
join_11 = List.Join(list0=code_block_67, list1=firstItem_10)
byJoinedSurfaces_10 = PolySurface.ByJoinedSurfaces(surfaces=join_11)

# group: 박스 배치 (대지경계와 안겹치는) - 추후 도로 및 이동 관련 추가해야함
# 설명 <그룹 설명을 편집하려면 여기를 두 번 클릭하십시오.>
박스INDEX_11 = CodeBlock { 10; }
code_block_68 = CodeBlock(a=byPatch, b=박스INDEX_11) { a[b]; }
code_block_69 = CodeBlock(a=pointAtParameter, b=박스INDEX_11) { a[b]; }
byTwoPoints_11 = Vector.ByTwoPoints(start=code_block_69, end=shuffle_11)
translate_11 = Geometry.Translate(geometry=code_block_68, direction=byTwoPoints_11)
code_block_70 = CodeBlock(제외영역=byJoinedSurfaces_10) { 제외영역; }
doesIntersect_12 = Geometry.DoesIntersect(geometry=code_block_70, other=translate_11, lacing=Longest)
filterByBoolMask_12 = List.FilterByBoolMask(list=translate_11, mask=doesIntersect_12)
flatten_35 = List.Flatten(list=filterByBoolMask_12.in)
flatten_36 = List.Flatten(list=filterByBoolMask_12.out)
firstItem_11 = List.FirstItem(list=flatten_36)

# group: 점 정리
# 설명 <그룹 설명을 편집하려면 여기를 두 번 클릭하십시오.>
intersect_13 = Geometry.Intersect(geometry=shuffle_11, other=firstItem_11)
flatten_37 = List.Flatten(list=intersect_13)
setDifference_11 = List.SetDifference(list1=setDifference_10, list2=flatten_37)

# group: 제목 <그룹 제목을 편집하려면 여기를 두 번 클릭하십시오.>
# 설명 <그룹 설명을 편집하려면 여기를 두 번 클릭하십시오.>
list_create = List.Create(item0=firstItem, item1=firstItem_2, item2=firstItem_3, item3=firstItem_4, item4=firstItem_5, item5=firstItem_6, item6=firstItem_7, item7=firstItem_8, item8=firstItem_9, item9=firstItem_10, item10=firstItem_11)
code_block_71 = CodeBlock { 0.5; }
pointAtParameter_3 = Surface.PointAtParameter(surface=list_create, u=code_block_71, v=code_block_71, lacing=CrossProduct)
n8_2 = CodeBlock(a=pointAtParameter_3) { a[7]; }  # "8"
n11 = CodeBlock(a=pointAtParameter_3) { a[10]; }  # "11"
n1_2 = CodeBlock(a=pointAtParameter_3) { a[0]; }  # "1"
n3_2 = CodeBlock(a=pointAtParameter_3) { a[2]; }  # "3"
n1_3 = Line.ByStartPointEndPoint(startPoint=n1_2, endPoint=n3_2)  # "1-3"
n2_2 = CodeBlock(a=pointAtParameter_3) { a[1]; }  # "2"
n2_3 = Line.ByStartPointEndPoint(startPoint=n2_2, endPoint=n3_2)  # "2-3"
n4_2 = CodeBlock(a=pointAtParameter_3) { a[3]; }  # "4"
n3_4 = Line.ByStartPointEndPoint(startPoint=n3_2, endPoint=n4_2)  # "3-4"
n5_2 = CodeBlock(a=pointAtParameter_3) { a[4]; }  # "5"
n4_5 = Line.ByStartPointEndPoint(startPoint=n4_2, endPoint=n5_2)  # "4-5"
n6_2 = CodeBlock(a=pointAtParameter_3) { a[5]; }  # "6"
n5_6 = Line.ByStartPointEndPoint(startPoint=n5_2, endPoint=n6_2)  # "5-6"
n9_2 = CodeBlock(a=pointAtParameter_3) { a[8]; }  # "9"
n6_12 = Line.ByStartPointEndPoint(startPoint=n6_2, endPoint=n9_2)  # "6-12"
n7_2 = CodeBlock(a=pointAtParameter_3) { a[6]; }  # "7"
n6_7 = Line.ByStartPointEndPoint(startPoint=n6_2, endPoint=n7_2)  # "6-7"
n10_2 = CodeBlock(a=pointAtParameter_3) { a[9]; }  # "10"
n11_12 = Line.ByStartPointEndPoint(startPoint=n9_2, endPoint=n10_2)  # "11-12"
join_12 = List.Join(list0=n1_3, list1=n2_3, list2=n3_4, list3=n4_5, list4=n5_6, list5=n6_12, list6=n6_7, list7=n11_12)
length = Curve.Length(curve=join_12)
code_block_72 = CodeBlock(a=length) { a/1; }
round = Math.Round(number=code_block_72)

# group: 배치 수
# 설명 <그룹 설명을 편집하려면 여기를 두 번 클릭하십시오.>
count = List.Count(list=list_create)  # graph output

# group: 연결 가까운 길이
# 설명 <그룹 설명을 편집하려면 여기를 두 번 클릭하십시오.>
거리 = Math.Sum(values=round)  # graph output

# group: Color
# 설명 <그룹 설명을 편집하려면 여기를 두 번 클릭하십시오.>
code_block_73 = CodeBlock { 1; }
thicken_3 = Surface.Thicken(surface=list_create, thickness=code_block_73)
color_palette = ColorPalette({R: 255, G: 0, B: 0, A: 255})
color_palette_2 = ColorPalette({R: 255, G: 64, B: 0, A: 255})
color_palette_3 = ColorPalette({R: 255, G: 127, B: 1, A: 255})
color_palette_4 = ColorPalette({R: 255, G: 192, B: 0, A: 255})
color_palette_5 = ColorPalette({R: 255, G: 255, B: 0, A: 255})
color_palette_6 = ColorPalette({R: 125, G: 255, B: 2, A: 255})
color_palette_7 = ColorPalette({R: 0, G: 254, B: 1, A: 255})
color_palette_8 = ColorPalette({R: 0, G: 255, B: 191, A: 255})
color_palette_9 = ColorPalette({R: 0, G: 255, B: 255, A: 255})
color_palette_10 = ColorPalette({R: 0, G: 192, B: 255, A: 255})
color_palette_11 = ColorPalette({R: 0, G: 128, B: 254, A: 255})
color_palette_12 = ColorPalette({R: 0, G: 67, B: 255, A: 255})
join_13 = List.Join(list0=color_palette, list1=color_palette_2, list2=color_palette_3, list3=color_palette_4, list4=color_palette_5, list5=color_palette_6, list6=color_palette_7, list7=color_palette_8, list8=color_palette_9, list9=color_palette_10, list10=color_palette_11, list11=color_palette_12)
byGeometryColor = Modifiers.GeometryColor.ByGeometryColor(geometry=thicken_3, color=join_13)

# group: TEXT
# 설명 <그룹 설명을 편집하려면 여기를 두 번 클릭하십시오.>
code_block_74 = CodeBlock { ["1","2","3","4","5","6","7","8","9,10,11","12","13"]; }
origin = Point.Origin()
code_block_75 = CodeBlock { 15; }
fromStringOriginAndScale = DynamoText.Text.FromStringOriginAndScale(text=code_block_74, origin=origin, scale=code_block_75)
byGroupedCurves = PolyCurve.ByGroupedCurves(curves=fromStringOriginAndScale)
byGeometry = BoundingBox.ByGeometry(geom=byGroupedCurves)
maxPoint = BoundingBox.MaxPoint(boundingBox=byGeometry)
X = Point.X(point=maxPoint)
minPoint = BoundingBox.MinPoint(boundingBox=byGeometry)
X_2 = Point.X(point=minPoint)
sub = X - X_2
Y = Point.Y(point=maxPoint)
Y_2 = Point.Y(point=minPoint)
sub_2 = Y - Y_2
byCoordinates = Point.ByCoordinates(x=sub, y=sub_2)
code_block_76 = CodeBlock(points=pointAtParameter_3) { points; }
X_3 = Point.X(point=code_block_76)
Y_3 = Point.Y(point=code_block_76)
code_block_77 = CodeBlock(a=sub_2) { a/2; }
add = Y_3 + code_block_77
ZAxis = Vector.ZAxis()
code_block_78 = CodeBlock { 2; }

code_block_79 = CodeBlock(a=sub) { a/2; }

# group (continued): TEXT
add_2 = X_3 + code_block_79
byCoordinates_2 = Point.ByCoordinates(x=add_2, y=add)
byTwoPoints_12 = Vector.ByTwoPoints(start=byCoordinates, end=byCoordinates_2)
translate_12 = Geometry.Translate(geometry=byGroupedCurves, direction=byTwoPoints_12)
translate_13 = Geometry.Translate(geometry=translate_12, direction=ZAxis, distance=code_block_78)

code_block_80 = CodeBlock { 4; }
takeItems = List.TakeItems(list=byPatch, amount=code_block_80)

# group: 제외영역 Set
# 설명 <그룹 설명을 편집하려면 여기를 두 번 클릭하십시오.>
code_block_81 = CodeBlock(대지경계=scale_2) { 대지경계; }
code_block_82 = CodeBlock { -10; }
offsetMany_2 = Curve.OffsetMany(curve=code_block_81, signedDistance=code_block_82)
join_14 = List.Join(list0=code_block_81, list1=offsetMany_2)
byLoft_2 = Surface.ByLoft(crossSections=join_14)
thicken_4 = Surface.Thicken(surface=byLoft_2)

python_script = Python(IN[0]=takeItems, IN[1]=flatten_2, IN[2]=byLoft_2)  # CPython3
# ---------- python_script.python (111 lines) ----------
import clr

# Revit 및 Dynamo API 라이브러리 참조 추가
clr.AddReference("RevitAPI")
clr.AddReference("ProtoGeometry")

from Autodesk.DesignScript.Geometry import *
import sys

# 입력 데이터 가져오기
surfaces_to_place = IN[0] # 배치할 Surface 들
target_points = IN[1]     # 배치될 위치 후보 점들
pre_existing_obstacles = IN[2] # 처음부터 존재하는 장애물 Surface(들)

# --- 수정된 부분: 최종 배치 리스트 초기화 ---
# final_placements 리스트를 IN[2]의 장애물로 초기화합니다.
final_placements = []
if pre_existing_obstacles is not None:
    # 입력이 단일 객체인지 리스트인지 확인하여 모두 처리
    if isinstance(pre_existing_obstacles, list):
        final_placements.extend(pre_existing_obstacles)
    else:
        final_placements.append(pre_existing_obstacles)
# ---------------------------------------------

# 사용 가능한 포인트를 리스트로 관리
available_points = list(target_points)

# 각 Surface를 순서대로 배치
for i, current_surface in enumerate(surfaces_to_place):
    print(f"\n--- Processing Surface {i+1} ---")

    if not available_points:
        print("DEBUG: No available points left.")
        break

    placement_successful = False
    
    # 배치 가능한 포인트를 순회하며 시도 (인덱스 접근을 위해 enumerate 사용)
    for p_index, p_point in enumerate(list(available_points)): # 순회 중 삭제를 위한 복사본 사용
        print(f"\n  Trying Point {p_index+1} at {p_point.ToString()}")
        
        # 후보 지오메트리 생성
        bbox = current_surface.BoundingBox
        original_center = Point.ByCoordinates(
            (bbox.MinPoint.X + bbox.MaxPoint.X) / 2.0,
            (bbox.MinPoint.Y + bbox.MaxPoint.Y) / 2.0,
            (bbox.MinPoint.Z + bbox.MaxPoint.Z) / 2.0
        )
        translation_vector = Vector.ByTwoPoints(original_center, p_point)
        candidate_s = current_surface.Translate(translation_vector)

        is_overlapping = False
        
        # 이전에 배치된 모든 Surface(초기 장애물 포함)와 개별적으로 비교
        for j, existing_surface in enumerate(final_placements):
            print(f"    Checking against existing geometry {j+1}...")
            
            try:
                intersect_result = existing_surface.Intersect(candidate_s)
                
                if not intersect_result:
                    print("      -> Intersect Result: Is EMPTY. No overlap found.")
                    continue

                if not isinstance(intersect_result, list):
                    intersect_result = [intersect_result]

                print(f"      -> Intersect Result: Found {len(intersect_result)} intersection object(s).")
                
                for item_index, item in enumerate(intersect_result):
                    item_type_name = item.GetType().Name
                    item_bbox_diag = item.BoundingBox.MaxPoint.DistanceTo(item.BoundingBox.MinPoint)
                    print(f"        - Item {item_index+1}: Type is '{item_type_name}', BBox Diagonal is {item_bbox_diag:.4f}")
                    
                    if isinstance(item, (Solid, Surface, PolySurface, Mesh)):
                        if item_bbox_diag > 0.001:
                            print("        !!! REAL OVERLAP DETECTED !!!")
                            is_overlapping = True
                            break
            except Exception as e:
                print(f"      !!! INTERSECT CHECK FAILED with error: {e} !!!")
                is_overlapping = True
            
            if is_overlapping:
                break
        
        if not is_overlapping:
            print(f"  --> SUCCESS! This position is valid.")
            final_placements.append(candidate_s)
            # 원본 리스트에서 해당 인덱스의 아이템을 제거
            # pop()을 사용하기 위해 순회 시 복사본을 사용해야 함
            original_index_to_remove = available_points.index(p_point)
            available_points.pop(original_index_to_remove)

            placement_successful = True
            break
    
    if not placement_successful:
        print(f"WARNING: Could not find any valid placement for Surface {i+1}")

# 최종 결과물 출력: IN[0]으로 들어온 것들만 골라서 출력
# final_placements에는 초기 장애물이 포함되어 있으므로, 이를 제외하고 출력합니다.
num_obstacles = 0
if pre_existing_obstacles is not None:
    num_obstacles = len(pre_existing_obstacles) if isinstance(pre_existing_obstacles, list) else 1

# 순수하게 이번 스크립트에서 배치된 결과만 슬라이싱하여 출력
newly_placed_surfaces = final_placements[num_obstacles:]

OUT = newly_placed_surfaces
# ----------------------------------------
code_block_83 = CodeBlock(a=python_script) { a[2]; }
code_block_84 = CodeBlock(a=code_block_83) { a[1]; }
code_block_85 = CodeBlock(a=code_block_83) { a[2]; }
code_block_86 = CodeBlock(a=code_block_83) { a[3]; }
