# Dynamo graph 시설 배치 관련 v2.dyn (Dynamo 2.19.3.6394)
# packages: GenerativeDesign 6.1.1.0

# group: 박스
# 설명 <그룹 설명을 편집하려면 여기를 두 번 클릭하십시오.>
select_model_elements = DSModelElementsSelection()  # 16 picked in the model
geometry = Element.Geometry(element=select_model_elements)
flatten = List.Flatten(list=geometry)
byGroupedCurves = PolyCurve.ByGroupedCurves(curves=flatten)

code_block = CodeBlock { 0.5; }

# group: 대지 경계
# 설명 <그룹 설명을 편집하려면 여기를 두 번 클릭하십시오.>
select_model_elements_2 = DSModelElementsSelection()  # 7 picked in the model
geometry_2 = Element.Geometry(element=select_model_elements_2)
flatten_2 = List.Flatten(list=geometry_2)
byGroupedCurves_2 = PolyCurve.ByGroupedCurves(curves=flatten_2)

# group: Data Remember
# 설명 <그룹 설명을 편집하려면 여기를 두 번 클릭하십시오.>
remember = Data.Remember(byGroupedCurves)
remember_2 = Data.Remember(byGroupedCurves_2)
code_block_2 = CodeBlock {  }
code_block_3 = CodeBlock {  }

byPatch = Surface.ByPatch(closedCurve=remember)
pointAtParameter = Surface.PointAtParameter(surface=byPatch, u=code_block, v=code_block, lacing=CrossProduct)

# group: 대지 내부 배치 가능 포인트 - 추후 지형, 이격 관련 추가해야함
# 설명 <그룹 설명을 편집하려면 여기를 두 번 클릭하십시오.>
byPatch_2 = Surface.ByPatch(closedCurve=remember_2)
code_block_4 = CodeBlock { 0..1..0.1; }
pointAtParameter_2 = Surface.PointAtParameter(surface=byPatch_2, u=code_block_4, v=code_block_4, lacing=CrossProduct)
flatten_3 = List.Flatten(list=pointAtParameter_2)
thicken = Surface.Thicken(surface=byPatch_2)
doesIntersect = Geometry.DoesIntersect(geometry=thicken, other=flatten_3, lacing=Longest)
filterByBoolMask = List.FilterByBoolMask(list=flatten_3, mask=doesIntersect)
flatten_4 = List.Flatten(list=filterByBoolMask.in)

# group: 점 Shuffle (Input)
# 설명 <그룹 설명을 편집하려면 여기를 두 번 클릭하십시오.>
n0 = IntegerSlider(82, range=0..100 step 1)  # "0"; graph input
shuffle = List.Shuffle(list=flatten_4, seed=n0)

# group: 제외영역 Set
# 설명 <그룹 설명을 편집하려면 여기를 두 번 클릭하십시오.>
code_block_5 = CodeBlock(대지경계=remember_2) { 대지경계; }
code_block_6 = CodeBlock { -10000; }
offsetMany = Curve.OffsetMany(curve=code_block_5, signedDistance=code_block_6)
join = List.Join(list0=code_block_5, list1=offsetMany)
byLoft = Surface.ByLoft(crossSections=join)
thicken_2 = Surface.Thicken(surface=byLoft)

# group: 박스 배치 (대지경계와 안겹치는) - 추후 도로 및 이동 관련 추가해야함
# 설명 <그룹 설명을 편집하려면 여기를 두 번 클릭하십시오.>
박스INDEX = CodeBlock { 0; }
code_block_7 = CodeBlock(a=byPatch, b=박스INDEX) { a[b]; }
code_block_8 = CodeBlock(a=pointAtParameter, b=박스INDEX) { a[b]; }
byTwoPoints = Vector.ByTwoPoints(start=code_block_8, end=shuffle)
translate = Geometry.Translate(geometry=code_block_7, direction=byTwoPoints)
code_block_9 = CodeBlock(제외영역=thicken_2) { 제외영역; }
doesIntersect_2 = Geometry.DoesIntersect(geometry=code_block_9, other=translate, lacing=Longest)
filterByBoolMask_2 = List.FilterByBoolMask(list=translate, mask=doesIntersect_2)
flatten_5 = List.Flatten(list=filterByBoolMask_2.in)
flatten_6 = List.Flatten(list=filterByBoolMask_2.out)
firstItem = List.FirstItem(list=flatten_6)

# group: rec0 배치
# 설명 <그룹 설명을 편집하려면 여기를 두 번 클릭하십시오.>
code_block_10 = CodeBlock {  }
code_block_11 = CodeBlock {  }

# group: 점 정리
# 설명 <그룹 설명을 편집하려면 여기를 두 번 클릭하십시오.>
intersect = Geometry.Intersect(geometry=shuffle, other=firstItem)
flatten_7 = List.Flatten(list=intersect)
setDifference = List.SetDifference(list1=flatten_4, list2=flatten_7)

# group: 점 Shuffle (Input)
# 설명 <그룹 설명을 편집하려면 여기를 두 번 클릭하십시오.>
n1 = IntegerSlider(95, range=0..100 step 1)  # "1"; graph input
shuffle_2 = List.Shuffle(list=setDifference, seed=n1)

# group: 제외영역 Surface > PolySurface
# 설명 <그룹 설명을 편집하려면 여기를 두 번 클릭하십시오.>
code_block_12 = CodeBlock(제외영역=byLoft) { 제외영역; }
join_2 = List.Join(list0=code_block_12, list1=firstItem)
byJoinedSurfaces = PolySurface.ByJoinedSurfaces(surfaces=join_2)

# group: 박스 배치 (대지경계와 안겹치는) - 추후 도로 및 이동 관련 추가해야함
# 설명 <그룹 설명을 편집하려면 여기를 두 번 클릭하십시오.>
박스INDEX_2 = CodeBlock { 1; }
code_block_13 = CodeBlock(a=byPatch, b=박스INDEX_2) { a[b]; }
code_block_14 = CodeBlock(a=pointAtParameter, b=박스INDEX_2) { a[b]; }
byTwoPoints_2 = Vector.ByTwoPoints(start=code_block_14, end=shuffle_2)
translate_2 = Geometry.Translate(geometry=code_block_13, direction=byTwoPoints_2)
code_block_15 = CodeBlock(제외영역=byJoinedSurfaces) { 제외영역; }
doesIntersect_3 = Geometry.DoesIntersect(geometry=code_block_15, other=translate_2, lacing=Longest)
filterByBoolMask_3 = List.FilterByBoolMask(list=translate_2, mask=doesIntersect_3)
flatten_8 = List.Flatten(list=filterByBoolMask_3.in)
flatten_9 = List.Flatten(list=filterByBoolMask_3.out)
firstItem_2 = List.FirstItem(list=flatten_9)

# group: rec1 배치
# 설명 <그룹 설명을 편집하려면 여기를 두 번 클릭하십시오.>
code_block_16 = CodeBlock {  }
code_block_17 = CodeBlock {  }

# group: 점 정리
# 설명 <그룹 설명을 편집하려면 여기를 두 번 클릭하십시오.>
intersect_2 = Geometry.Intersect(geometry=shuffle_2, other=firstItem_2)
flatten_10 = List.Flatten(list=intersect_2)
setDifference_2 = List.SetDifference(list1=setDifference, list2=flatten_10)

# group: 점 Shuffle (Input)
# 설명 <그룹 설명을 편집하려면 여기를 두 번 클릭하십시오.>
n2 = IntegerSlider(85, range=0..100 step 1)  # "2"; graph input
shuffle_3 = List.Shuffle(list=setDifference_2, seed=n2)

# group: 제외영역 Surface > PolySurface
# 설명 <그룹 설명을 편집하려면 여기를 두 번 클릭하십시오.>
code_block_18 = CodeBlock(제외영역=byJoinedSurfaces) { 제외영역; }
join_3 = List.Join(list0=code_block_18, list1=firstItem_2)
byJoinedSurfaces_2 = PolySurface.ByJoinedSurfaces(surfaces=join_3)

# group: 박스 배치 (대지경계와 안겹치는) - 추후 도로 및 이동 관련 추가해야함
# 설명 <그룹 설명을 편집하려면 여기를 두 번 클릭하십시오.>
박스INDEX_3 = CodeBlock { 2; }
code_block_19 = CodeBlock(a=byPatch, b=박스INDEX_3) { a[b]; }
code_block_20 = CodeBlock(a=pointAtParameter, b=박스INDEX_3) { a[b]; }
byTwoPoints_3 = Vector.ByTwoPoints(start=code_block_20, end=shuffle_3)
translate_3 = Geometry.Translate(geometry=code_block_19, direction=byTwoPoints_3)
code_block_21 = CodeBlock(제외영역=byJoinedSurfaces_2) { 제외영역; }
doesIntersect_4 = Geometry.DoesIntersect(geometry=code_block_21, other=translate_3, lacing=Longest)
filterByBoolMask_4 = List.FilterByBoolMask(list=translate_3, mask=doesIntersect_4)
flatten_11 = List.Flatten(list=filterByBoolMask_4.in)
flatten_12 = List.Flatten(list=filterByBoolMask_4.out)
firstItem_3 = List.FirstItem(list=flatten_12)

# group: rec2 배치
# 설명 <그룹 설명을 편집하려면 여기를 두 번 클릭하십시오.>
code_block_22 = CodeBlock {  }
code_block_23 = CodeBlock {  }

# group: 점 정리
# 설명 <그룹 설명을 편집하려면 여기를 두 번 클릭하십시오.>
intersect_3 = Geometry.Intersect(geometry=shuffle_3, other=firstItem_3)
flatten_13 = List.Flatten(list=intersect_3)
setDifference_3 = List.SetDifference(list1=setDifference_2, list2=flatten_13)

# group: 점 Shuffle (Input)
# 설명 <그룹 설명을 편집하려면 여기를 두 번 클릭하십시오.>
n3 = IntegerSlider(58, range=0..100 step 1)  # "3"; graph input
shuffle_4 = List.Shuffle(list=setDifference_3, seed=n3)

# group: 제외영역 Surface > PolySurface
# 설명 <그룹 설명을 편집하려면 여기를 두 번 클릭하십시오.>
code_block_24 = CodeBlock(제외영역=byJoinedSurfaces_2) { 제외영역; }
join_4 = List.Join(list0=code_block_24, list1=firstItem_3)
byJoinedSurfaces_3 = PolySurface.ByJoinedSurfaces(surfaces=join_4)

# group: 박스 배치 (대지경계와 안겹치는) - 추후 도로 및 이동 관련 추가해야함
# 설명 <그룹 설명을 편집하려면 여기를 두 번 클릭하십시오.>
박스INDEX_4 = CodeBlock { 3; }
code_block_25 = CodeBlock(a=byPatch, b=박스INDEX_4) { a[b]; }
code_block_26 = CodeBlock(a=pointAtParameter, b=박스INDEX_4) { a[b]; }
byTwoPoints_4 = Vector.ByTwoPoints(start=code_block_26, end=shuffle_4)
translate_4 = Geometry.Translate(geometry=code_block_25, direction=byTwoPoints_4)
code_block_27 = CodeBlock(제외영역=byJoinedSurfaces_3) { 제외영역; }
doesIntersect_5 = Geometry.DoesIntersect(geometry=code_block_27, other=translate_4, lacing=Longest)
filterByBoolMask_5 = List.FilterByBoolMask(list=translate_4, mask=doesIntersect_5)
flatten_14 = List.Flatten(list=filterByBoolMask_5.in)
flatten_15 = List.Flatten(list=filterByBoolMask_5.out)
firstItem_4 = List.FirstItem(list=flatten_15)

# group: rec3 배치
# 설명 <그룹 설명을 편집하려면 여기를 두 번 클릭하십시오.>
code_block_28 = CodeBlock {  }
code_block_29 = CodeBlock {  }

# group: 점 정리
# 설명 <그룹 설명을 편집하려면 여기를 두 번 클릭하십시오.>
intersect_4 = Geometry.Intersect(geometry=shuffle_4, other=firstItem_4)
flatten_16 = List.Flatten(list=intersect_4)
setDifference_4 = List.SetDifference(list1=setDifference_3, list2=flatten_16)

# group: 제목 <그룹 제목을 편집하려면 여기를 두 번 클릭하십시오.>
# 설명 <그룹 설명을 편집하려면 여기를 두 번 클릭하십시오.>
list_create = List.Create(item0=firstItem, item1=firstItem_2, item2=firstItem_3, item3=firstItem_4)
code_block_30 = CodeBlock { 0.5; }
pointAtParameter_3 = Surface.PointAtParameter(surface=list_create, u=code_block_30, v=code_block_30, lacing=CrossProduct)
n1_2 = CodeBlock(a=pointAtParameter_3) { a[0]; }  # "1"
n3_2 = CodeBlock(a=pointAtParameter_3) { a[2]; }  # "3"
n1_3 = Line.ByStartPointEndPoint(startPoint=n1_2, endPoint=n3_2)  # "1-3"
n2_2 = CodeBlock(a=pointAtParameter_3) { a[1]; }  # "2"
n2_3 = Line.ByStartPointEndPoint(startPoint=n2_2, endPoint=n3_2)  # "2-3"
n4 = CodeBlock(a=pointAtParameter_3) { a[3]; }  # "4"
n3_4 = Line.ByStartPointEndPoint(startPoint=n3_2, endPoint=n4)  # "3-4"
join_5 = List.Join(list0=n1_3, list1=n2_3, list2=n3_4)
length = Curve.Length(curve=join_5)
code_block_31 = CodeBlock(a=length) { a/1000; }
round = Math.Round(number=code_block_31)

# group: 배치 수
# 설명 <그룹 설명을 편집하려면 여기를 두 번 클릭하십시오.>
count = List.Count(list=list_create)  # graph output

# group: 연결 가까운 길이
# 설명 <그룹 설명을 편집하려면 여기를 두 번 클릭하십시오.>
거리 = Math.Sum(values=round)

# group: Color
# 설명 <그룹 설명을 편집하려면 여기를 두 번 클릭하십시오.>
code_block_32 = CodeBlock { 1; }
thicken_3 = Surface.Thicken(surface=list_create, thickness=code_block_32)
color_palette = ColorPalette({R: 255, G: 0, B: 0, A: 255})
color_palette_2 = ColorPalette({R: 255, G: 64, B: 0, A: 255})
color_palette_3 = ColorPalette({R: 255, G: 127, B: 1, A: 255})
color_palette_4 = ColorPalette({R: 255, G: 192, B: 0, A: 255})
color_palette_5 = ColorPalette({R: 255, G: 255, B: 0, A: 255})
color_palette_6 = ColorPalette({R: 125, G: 255, B: 2, A: 255})
color_palette_7 = ColorPalette({R: 0, G: 254, B: 1, A: 255})
color_palette_8 = ColorPalette({R: 0, G: 255, B: 191, A: 255})
color_palette_9 = ColorPalette({R: 0, G: 255, B: 255, A: 255})
color_palette_10 = ColorPalette({R: 0, G: 192, B: 255, A: 255})
color_palette_11 = ColorPalette({R: 0, G: 128, B: 254, A: 255})
color_palette_12 = ColorPalette({R: 0, G: 67, B: 255, A: 255})
join_6 = List.Join(list0=color_palette, list1=color_palette_2, list2=color_palette_3, list3=color_palette_4, list4=color_palette_5, list5=color_palette_6, list6=color_palette_7, list7=color_palette_8, list8=color_palette_9, list9=color_palette_10, list10=color_palette_11, list11=color_palette_12)
byGeometryColor = Modifiers.GeometryColor.ByGeometryColor(geometry=thicken_3, color=join_6)
